# Grasshopper definition exportSTL.gh (Grasshopper 0.9.76)
# plug-ins: Python Interpreter, LunchBox, TT Toolbox

# ---- group: parameters starts with zero
x_value = Slider(1, range=1..6)
y_value = Slider(1, range=1..6)
z_value = Slider(1, range=1..6)

# ---- group: Modeling
num = Number(x_value)
num_2 = Number(y_value)
num_3 = Number(z_value)
Z = UnitZ(Factor=num_3)
box = CenterBox(Base=PlaneXY(0, 0, 0), X=num, Y=num_2, Z=num_3)
move = Move(Geometry=box, Motion=Z)  # -> Geometry, Transform

# ---- group: filename and delete previous export
panel = Panel([num, num_2, num_3])
panel_2 = Panel("""R
H
O""")
python = PythonScript(tags=panel_2, values=panel)  # -> out, a; inputs tags: list, values: list of Int32
# ---------- python: Python ----------
import rhinoscriptsyntax as rs

rs.Command("_selall")
rs.Command("_delete")

myStr = []
for x in range(len(tags)):
    myStr.append( tags[x] + str(int(values[x])) )

a = '_'.join(myStr) + '.stl'
# ---------- end python ----------
panel_3 = Panel(python.a)

# ---- group: exporting params
panel_4 = Panel("C:\Users\ptr\Assignments\whiteRoom\deployment\peayad.github.io\3js\04\STL")
toggle = BooleanToggle(False)
brep = Brep(move.Geometry)
save = ObjectSave(
    BakeToggle=toggle,
    FileDirectory=panel_4,
    FileName=panel_3,
    GeometryObjects=brep,
    Layer="GH_Export",
    ObjectName=panel_3,
    ObjectColor=RGB(255, 255, 255),
    LayerColor=RGB(255, 255, 255))
bt = BruteForce(NumberSlider=[x_value, y_value, z_value], RunTheScript=toggle)
