# Grasshopper definition create_JSON.gh (Grasshopper 0.9.76)

number_01 = Panel("""{
	"metadata": {
		"formatVersion": 3.2,
		"type": "scene"
	},

	"urlBaseType": "relativeToHTML",

	"objects": {

		"group": {
			"position": [0, 0, 0],
			"rotation": [0, 0, 0],
			"scale": [1, 1, 1],
			"visible": true,
			"children": {""")
number_03 = Panel(""""mainCamera": {
					"type": "PerspectiveCamera",
					"fov": 50,
					"aspect": 1.33333,
					"near": 1,
					"far": 5000,
					"position": [0, 0, 250],
					"target": [0, 0, 0]
				},

				"light1": {
					"type": "PointLight",
					"position": [0, 200, 0],
					"color": 16777215,
					"intensity": 1
				},

				"light2": {
					"type": "PointLight",
					"position": [100, 200, 100],
					"color": 16777215,
					"intensity": 1
				},

				"light3": {
					"type": "PointLight",
					"position": [-100, -200, -100],
					"color": 16777215,
					"intensity": 1
				}
			}
		}
	},

	"geometries": {""")
number_05 = Panel("""},

	"materials": {

		"myMaterial": {
			"type": "MeshPhongMaterial",
			"parameters": {
				"color": 1401481,
				"emissive": 468276,
				"side": "double",
				"shading": "flat"
			}
		}

	},

	"defaults": {
		"bgcolor": [0, 0, 0],
		"bgalpha": 1,
		"camera": "mainCamera"
	}
}""")
number_04 = Panel(""""L1_H1_V1": {
			"type": "ctm",
			"url": "models/L1_H1_V1.ctm"
}""")
number_02 = Panel(""""L1_H1_V1": {
					"geometry": "L1_H1_V1",
					"material": "myMaterial",
					"position": [0, 0, 0],
					"rotation": [0, 0, 0],
					"scale": [1, 1, 1],
					"visible": true
				},""")
mereged = Panel([number_01, number_02, number_03, number_04, number_05])
streamed_to_folder = Panel(mereged)
